% Simulink data dictionary asbCubeSatModelData.sldd

visOff = Simulink.Variant(Condition="variantVisualization == 0")
visSL3D = Simulink.Variant(Condition="variantVisualization == 1")
variantVisualization = 1
gains = struct(Kp=5.5e-5, Ki=0, Kd=0.017)

ACSOutBus = Simulink.Bus()
  AttitudeError: AttitudeErrorBus
  MomentCmds: double[3]
  cmd_q_b2tgt: double[4]
  NavMode: double

FCSOutBus = Simulink.Bus()
  ACSOut: ACSOutBus

AttitudeErrorBus = Simulink.Bus()
  Roll: double
  Pitch: double
  Yaw: double

EnvBus = Simulink.Bus()
  envAccel_ecef: double[3]
  envForces_body: double[3]
  envTorques_body: double[3]
  x_sun_eci: double[3]
  earthAngRate: double[3]
  mag_NED: double[3]

vehicle = struct(mass=1.3, inertia=[0.00216666667 0 0; 0 0.00216666667 0; 0 0 0.00216666667])
actuator = struct(maxCurrent=2, n1=105, A1=0.0007068583, n2=105, A2=0.0007068583, n3=47, A3=0.0081)

StatesOutBus = Simulink.Bus()
  utc_JD: double
  X_ecef: double[3]
  V_ecef: double[3]
  X_eci: double[3]
  V_eci: double[3]
  q_ecef2b: double[4]
  q_eci2b: double[4]
  Euler: double[3]
  LatLonAlt: double[3]
  SunAngle: double
  SunInView: boolean
  omega_ned: double[3], Unit="deg/s"  % angular rate of body frame wrt ned frame, expressed in ned frame

CubeSatTimeStep = 0.5

initCond = struct(
  simStartDate=struct(JD=2458488, dateVector=[2019 1 4 12 0 0]),
  CoordEpoch=struct(JD=2451545, dateVector=[2000 1 1 12 0 0]),
  OrbitalElements=struct(
    semiMajorAxis=6786233.13,
    eccentricity=0.0010537,
    inclination=51.7519,
    RAAN=95.2562,
    argumentOfPerigee=93.4872,
    trueAnomoly=302.9234,
    trueLongitude=0,
    argumentOfLatititude=0,
    longitudeOfPerigee=0),
  r_eci=[-2981784 5207056 3161595],
  v_eci=[-3384.483 -4887.76 4843.461],
  r_ecef=[-5762651 -1682704 3156028],
  v_ecef=[3832.57 -4024.901 4837.431],
  lla=[27.8808 -163.7221 408851.6],
  v_ned=[5468.74 4937.813 -7.462737],
  uvw=[5468.74 4937.813 -7.462737],
  euler=[180 180 180],
  pqr=[0.1 0.1 0.1])